# Grasshopper definition clt_configuration_test.gh (Grasshopper 1.0.8)
# plug-ins: RhinoCodePluginGH, Human

panel = Panel("""# Import necessary modules
import Rhino
import rhinoscriptsyntax as rs
import scriptcontext as sc
import math
import numpy as np
from numba import njit  # Numba for JIT compilation

# Define material libraries
materials_library = {
    'Wood': {
        'density': 600,           # kg/m³
        'embodied_carbon': 0.4,   # kg CO₂e per kg
        'recycled_content': 0.0,  # %
        'recyclability': 0.95     # %
    },
    'Steel': {
        'density': 7850,          # kg/m³
        'embodied_carbon': 2.0,   # kg CO₂e per kg
        'recycled_content': 0.6,  # %
        'recyclability': 0.9      # %
    },
    'Glue': {
        'density': 1200,          # kg/m³
        'embodied_carbon': 1.0,   # kg CO₂e per kg
        'recycled_content': 0.0,  # %
        'recyclability': 0.0      # %
    },
    # Add more materials as needed
}

# Map qualitative circularity inputs to numerical values
qualitative_scores = {
    'Low': 0.25,
    'Medium': 0.5,
    'High': 0.75
}

# Ensure that input lists have correct lengths
if len(layer_thicknesses) != num_layers:
    raise ValueError("'layer_thicknesses' list must have a length equal to 'num_layers'.")
if len(board_widths) != num_layers:
    raise ValueError("'board_widths' list must have a length equal to 'num_layers'.")
if len(gap_sizes) != num_layers:
    raise ValueError("'gap_sizes' list must have a length equal to 'num_layers'.")

# Fetch material properties based on user selection
board_material_properties = materials_library.get(board_material, materials_library['Wood'])
connector_material_properties = materials_library.get(connector_material, materials_library['Steel'])
glue_material_properties = materials_library.get(glue_material, materials_library['Glue'])

# Assign material properties
wood_density = board_material_properties['density']
wood_ec = board_material_properties['embodied_carbon']
wood_recycled_content = board_material_properties['recycled_content']
wood_recyclability = board_material_properties['recyclability']

connector_density = connector_material_properties['density']
connector_ec = connector_material_properties['embodied_carbon']
connector_recycled_content = connector_material_properties['recycled_content']
connector_recyclability = connector_material_properties['recyclability']

glue_density = glue_material_properties['density']
glue_ec = glue_material_properties['embodied_carbon']
glue_recycled_content = glue_material_properties['recycled_content']
glue_recyclability = glue_material_properties['recyclability']

# Initialize variables
current_z = 0.0
glue_thickness = float(glue_thickness)  # Thickness of glue layers (mm)

# Precompute panel dimensions
half_panel_length = panel_length / 2.0
half_panel_width = panel_width / 2.0

# Prepare lists for positions and dimensions
board_dims_list = []
glue_dims_list = []
x_board_positions = set()
y_board_positions = set()

# Loop through each layer to compute board dimensions and positions
for layer in range(num_layers):
    lt = layer_thicknesses[layer]
    bw = board_widths[layer]
    gs = gap_sizes[layer]

    # Determine orientation
    is_x_direction = ((layer + start_orientation) % 2 == 0)

    # Panel dimensions and fixed coordinates
    if is_x_direction:
        panel_dim = panel_width
        panel_length_dim = panel_length
        fixed_coord_min = -half_panel_length
        fixed_coord_max = half_panel_length
        positions_set = y_board_positions
    else:
        panel_dim = panel_length
        panel_length_dim = panel_width
        fixed_coord_min = -half_panel_width
        fixed_coord_max = half_panel_width
        positions_set = x_board_positions

    # Calculate number of boards and adjusted board width
    num_boards = max(int((panel_dim + gs) / (bw + gs)), 1)
    total_gap = gs * (num_boards - 1)
    adjusted_bw = (panel_dim - total_gap) / num_boards

    # Generate positions
    coords0 = np.linspace(-panel_dim / 2.0, panel_dim / 2.0 - adjusted_bw, num_boards)
    coords1 = coords0 + adjusted_bw
    center_coords = (coords0 + coords1) * 0.5
    positions_set.update(center_coords.tolist())

    # Set x and y coordinates based on orientation
    if is_x_direction:
        x0 = np.full(num_boards, fixed_coord_min)
        x1 = np.full(num_boards, fixed_coord_max)
        y0 = coords0
        y1 = coords1
    else:
        x0 = coords0
        x1 = coords1
        y0 = np.full(num_boards, fixed_coord_min)
        y1 = np.full(num_boards, fixed_coord_max)

    z0 = np.full(num_boards, current_z)
    z1 = z0 + lt

    # Stack dimensions
    board_dims_layer = np.column_stack((x0, x1, y0, y1, z0, z1))
    board_dims_list.append(board_dims_layer)

    # Add glue layer dimensions
    if layer < num_layers - 1:
        z0_glue = current_z + lt
        z1_glue = z0_glue + glue_thickness
        glue_dims_list.append([-half_panel_length, half_panel_length,
                               -half_panel_width, half_panel_width,
                               z0_glue, z1_glue])

    # Update current Z position
    current_z += lt + (glue_thickness if layer < num_layers - 1 else 0)

total_thickness = current_z

# Combine dimensions into arrays
board_dims = np.vstack(board_dims_list)
glue_dims = np.array(glue_dims_list) if glue_dims_list else np.empty((0, 6))

# Convert positions to arrays
x_board_positions = np.array(sorted(x_board_positions))
y_board_positions = np.array(sorted(y_board_positions))

# Generate connectors positions and dimensions
X, Y = np.meshgrid(x_board_positions, y_board_positions)
X_flat = X.ravel()
Y_flat = Y.ravel()
connector_radii = np.full_like(X_flat, connector_diameter * 0.5)
connector_heights = np.full_like(X_flat, total_thickness)

# Numba-accelerated functions
@njit
def compute_box_volumes(dims):
    return (dims[:, 1] - dims[:, 0]) * (dims[:, 3] - dims[:, 2]) * (dims[:, 5] - dims[:, 4])

@njit
def compute_cylinder_volumes(radii, heights):
    return np.pi * radii * radii * heights

# Calculate volumes
wood_volumes = compute_box_volumes(board_dims) * 1e-9  # mm³ to m³
glue_volumes = compute_box_volumes(glue_dims) * 1e-9 if glue_dims.size else np.array([0.0])
connector_volumes = compute_cylinder_volumes(connector_radii, connector_heights) * 1e-9

# Calculate masses
total_wood_mass = wood_volumes.sum() * wood_density
total_glue_mass = glue_volumes.sum() * glue_density
total_connector_mass = connector_volumes.sum() * connector_density
total_mass = total_wood_mass + total_glue_mass + total_connector_mass

# Calculate embodied carbon
wood_embodied_carbon = total_wood_mass * wood_ec
glue_embodied_carbon = total_glue_mass * glue_ec
connector_embodied_carbon = total_connector_mass * connector_ec
total_embodied_carbon = wood_embodied_carbon + glue_embodied_carbon + connector_embodied_carbon

# Material efficiency ratio
material_required = total_wood_mass
material_efficiency_ratio = material_required / total_mass if total_mass else 0

# Waste diversion rate
manufacturing_waste = total_mass * manufacturing_waste_factor
construction_waste = total_mass * construction_waste_factor
total_waste = manufacturing_waste + construction_waste

waste_diverted = total_waste * (
    (total_wood_mass * wood_recyclability +
     total_glue_mass * glue_recyclability +
     total_connector_mass * connector_recyclability) / total_mass
) if total_mass else 0

waste_diversion_rate = waste_diverted / total_waste if total_waste else 0

# DfD score
ease_of_disassembly = qualitative_scores.get(ease_of_disassembly_input, 0.5)
material_separation = qualitative_scores.get(material_separation_input, 0.5)
standardization = qualitative_scores.get(standardization_input, 0.5)
weights = {'ease_of_disassembly': 0.4, 'material_separation': 0.3, 'standardization': 0.3}
dfd_score = (
    ease_of_disassembly * weights['ease_of_disassembly'] +
    material_separation * weights['material_separation'] +
    standardization * weights['standardization']
)

# Material Circularity Indicator (MCI)
wood_circularity = wood_recycled_content * wood_recyclability
glue_circularity = glue_recycled_content * glue_recyclability
connector_circularity = connector_recycled_content * connector_recyclability

weighted_circularity = (
    (wood_circularity * total_wood_mass +
     glue_circularity * total_glue_mass +
     connector_circularity * total_connector_mass) / total_mass
) if total_mass else 0

# Prepare metrics output
metrics_output = f\"\"\"
Total Embodied Carbon (kg CO₂e): {total_embodied_carbon:.2f}
Material Efficiency Ratio: {material_efficiency_ratio:.4f}
Waste Diversion Rate: {waste_diversion_rate:.4f}
DfD Score: {dfd_score:.2f}
MCI: {weighted_circularity:.4f}
\"\"\"

d = metrics_output.strip()

# Generate geometry only if necessary
generate_geometry = True # Set to False to skip geometry creation for speed

if generate_geometry:
    # Create CLT boards geometry
    clt_boards = []
    for dims in board_dims:
        xi0, xi1, yi0, yi1, zi0, zi1 = dims
        bbox = Rhino.Geometry.BoundingBox(
            Rhino.Geometry.Point3d(xi0, yi0, zi0),
            Rhino.Geometry.Point3d(xi1, yi1, zi1)
        )
        board = Rhino.Geometry.Box(bbox).ToBrep()
        clt_boards.append(board)

    # Create glue layers geometry
    glue_layers = []
    for dims in glue_dims:
        xi0, xi1, yi0, yi1, zi0, zi1 = dims
        plane = Rhino.Geometry.Plane(
            Rhino.Geometry.Point3d(0, 0, zi0), Rhino.Geometry.Vector3d.ZAxis)
        rect = Rhino.Geometry.Rectangle3d(
            plane,
            Rhino.Geometry.Interval(xi0, xi1),
            Rhino.Geometry.Interval(yi0, yi1)
        )
        extrusion = Rhino.Geometry.Extrusion.Create(rect.ToNurbsCurve(), zi1 - zi0, True)
        glue_solid = extrusion.ToBrep()
        glue_layers.append(glue_solid)

    # Create connectors geometry
    connectors = []
    for x, y, radius, height in zip(X_flat, Y_flat, connector_radii, connector_heights):
        base_point = Rhino.Geometry.Point3d(x, y, 0)
        circle = Rhino.Geometry.Circle(base_point, radius)
        cylinder = Rhino.Geometry.Cylinder(circle, height)
        connector = cylinder.ToBrep(True, True)
        connectors.append(connector)
else:
    clt_boards = []
    glue_layers = []
    connectors = []

# Assign geometry outputs
a = clt_boards
b = connectors
c = glue_layers""")

# ----
# Scalars
num_layers = Slider(6, range=3..9)
start_orientation = Slider(1, range=0..1)
glue_thickness = Slider(0.005, range=0.005..0.01)
connector_diameter = Slider(0.011, range=0.006..0.012)

# ----
# Lists
layer_thicknesses = Slider(0.028, range=0.02..0.05)
board_widths = Slider(0.178, range=0.15..0.25)
gap_sizes = Slider(0.005, range=0.005..0.02)
repeat_data = RepeatData(Data=layer_thicknesses, Length=num_layers)
repeat_data_2 = RepeatData(Data=board_widths, Length=num_layers)
repeat_data_3 = RepeatData(Data=gap_sizes, Length=num_layers)

python_i_o = ValueList({"ON": 0, "OFF": 1}, selected="ON")
c_i_o = ValueList({"ON": 0, "OFF": 1}, selected="OFF")
crv = Curve(<curve referenced from the Rhino model>)
crv_2 = Curve(<curve referenced from the Rhino model>)
filter = StreamFilter(Gate=python_i_o, Stream0=crv)
filter_2 = StreamFilter(Gate=c_i_o, Stream0=crv_2)

python_3_script = Python3Script(
    curve_reference=filter,
    glue_thickness=glue_thickness,
    num_layers=num_layers,
    layer_thicknesses=repeat_data,
    board_widths=repeat_data_2,
    gap_sizes=repeat_data_3,
    start_orientation=start_orientation,
    connector_diameter=connector_diameter)  # -> out, a, b; inputs curve_reference: Curve, glue_thickness: Double, num_layers: Int32, layer_thicknesses: list of Double, board_widths: list of Double, gap_sizes: list of Double, start_orientation: Int32, connector_diameter: Double
# ---------- python_3_script: Python ----------
import Rhino
import rhinoscriptsyntax as rs
import scriptcontext as sc
import math
import numpy as np
from numba import njit

# Grasshopper specific imports for DataTree
import Grasshopper
from Grasshopper import DataTree
from Grasshopper.Kernel.Data import GH_Path

# Validate input lists
if len(layer_thicknesses) != num_layers:
    raise ValueError("'layer_thicknesses' list must have a length equal to 'num_layers'.")
if len(board_widths) != num_layers:
    raise ValueError("'board_widths' list must have a length equal to 'num_layers'.")
if len(gap_sizes) != num_layers:
    raise ValueError("'gap_sizes' list must have a length equal to 'num_layers'.")

# Extract dimensions from the input curve
if not rs.IsCurve(curve_reference):
    raise ValueError("The referenced geometry must be a curve.")

# Get the bounding box for the reference curve
bounding_box = rs.BoundingBox(curve_reference)
bbox_min = bounding_box[0]
bbox_max = bounding_box[6]

# Calculate the panel dimensions from the bounding box of the curve
panel_length = bbox_max.X - bbox_min.X
panel_width = bbox_max.Y - bbox_min.Y
panel_height = bbox_max.Z - bbox_min.Z

# Initialize constants and precomputed values
glue_thickness = float(glue_thickness)

# Initialize output containers
board_dims_list = []
glue_dims_list = []
x_board_positions = set()
y_board_positions = set()

# Numba-accelerated helper function for board position calculations
@njit
def calculate_board_positions(fixed_coord_min, adjusted_bw, num_boards, gap_size):
    coords0 = fixed_coord_min + np.arange(num_boards) * (adjusted_bw + gap_size)
    coords1 = coords0 + adjusted_bw
    center_coords = (coords0 + coords1) * 0.5
    return coords0, coords1, center_coords

# Main loop to compute dimensions and positions
current_z = bbox_min.Z  # Start at the minimum Z of the bounding box
for layer in range(num_layers):
    lt = layer_thicknesses[layer]
    bw = board_widths[layer]
    gs = gap_sizes[layer]

    # Determine orientation and parameters
    is_x_direction = ((layer + start_orientation) % 2 == 0)
    positions_set = y_board_positions if is_x_direction else x_board_positions

    if is_x_direction:
        fixed_coord_min = bbox_min.Y
        fixed_coord_max = bbox_max.Y
        panel_dim = fixed_coord_max - fixed_coord_min
    else:
        fixed_coord_min = bbox_min.X
        fixed_coord_max = bbox_max.X
        panel_dim = fixed_coord_max - fixed_coord_min

    # Calculate number of boards and adjusted dimensions
    num_boards = max(int((panel_dim + gs) / (bw + gs)), 1)
    total_gap = gs * (num_boards - 1)
    adjusted_bw = (panel_dim - total_gap) / num_boards

    # Compute board positions
    coords0, coords1, center_coords = calculate_board_positions(fixed_coord_min, adjusted_bw, num_boards, gs)
    positions_set.update(center_coords.tolist())

    # Assign coordinates based on orientation
    if is_x_direction:
        x0 = np.full(num_boards, bbox_min.X)
        x1 = np.full(num_boards, bbox_max.X)
        y0, y1 = coords0, coords1
    else:
        x0, x1 = coords0, coords1
        y0 = np.full(num_boards, bbox_min.Y)
        y1 = np.full(num_boards, bbox_max.Y)

    z0 = np.full(num_boards, current_z)
    z1 = z0 + lt

    # Stack board dimensions
    board_dims_layer = np.column_stack((x0, x1, y0, y1, z0, z1))
    board_dims_list.append(board_dims_layer)

    # Add glue layer dimensions if necessary
    if layer < num_layers - 1:
        z0_glue = current_z + lt
        z1_glue = z0_glue + glue_thickness
        glue_dims_list.append([
            bbox_min.X, bbox_max.X,
            bbox_min.Y, bbox_max.Y,
            z0_glue, z1_glue
        ])

    # Update current Z position
    current_z += lt + (glue_thickness if layer < num_layers - 1 else 0)

# Combine all dimensions into arrays
board_dims = np.vstack(board_dims_list)
glue_dims = np.array(glue_dims_list) if glue_dims_list else np.empty((0, 6))
total_thickness = current_z - bbox_min.Z

# Convert positions to sorted arrays
x_board_positions = np.array(sorted(x_board_positions))
y_board_positions = np.array(sorted(y_board_positions))

# Generate connectors positions
X, Y = np.meshgrid(x_board_positions, y_board_positions)
X_flat, Y_flat = X.ravel(), Y.ravel()
connector_radii = np.full_like(X_flat, connector_diameter * 0.5)
connector_heights = np.full_like(X_flat, total_thickness)

# Generate geometry
def create_geometry(dims, create_func):
    return [create_func(*dim) for dim in dims]

def create_box(x0, x1, y0, y1, z0, z1):
    bbox = Rhino.Geometry.BoundingBox(
        Rhino.Geometry.Point3d(x0, y0, z0),
        Rhino.Geometry.Point3d(x1, y1, z1)
    )
    return Rhino.Geometry.Box(bbox).ToBrep()

def create_cylinder(x, y, radius, height):
    base_point = Rhino.Geometry.Point3d(x, y, bbox_min.Z)
    circle = Rhino.Geometry.Circle(base_point, radius)
    cylinder = Rhino.Geometry.Cylinder(circle, height)
    return cylinder.ToBrep(True, True)

# Create all geometries
clt_boards = create_geometry(board_dims, create_box)
glue_layers = create_geometry(glue_dims, lambda x0, x1, y0, y1, z0, z1:
    Rhino.Geometry.Extrusion.Create(
        Rhino.Geometry.Rectangle3d(
            Rhino.Geometry.Plane(Rhino.Geometry.Point3d(0, 0, z0), Rhino.Geometry.Vector3d.ZAxis),
            Rhino.Geometry.Interval(x0, x1),
            Rhino.Geometry.Interval(y0, y1)
        ).ToNurbsCurve(),
        z1 - z0, True).ToBrep()
)
connectors = create_geometry(zip(X_flat, Y_flat, connector_radii, connector_heights), create_cylinder)

# Compute volumes and other specifics

# Compute volumes of lamellas (boards)
board_volumes = []
for brep in clt_boards:
    volume_props = Rhino.Geometry.VolumeMassProperties.Compute(brep)
    if volume_props:
        board_volumes.append(volume_props.Volume)
    else:
        board_volumes.append(0.0)
total_board_volume = sum(board_volumes)

# Compute volumes of glue layers
glue_volumes = []
for brep in glue_layers:
    volume_props = Rhino.Geometry.VolumeMassProperties.Compute(brep)
    if volume_props:
        glue_volumes.append(volume_props.Volume)
    else:
        glue_volumes.append(0.0)
total_glue_volume = sum(glue_volumes)

# Compute volumes of connectors
connector_volumes = []
for brep in connectors:
    volume_props = Rhino.Geometry.VolumeMassProperties.Compute(brep)
    if volume_props:
        connector_volumes.append(volume_props.Volume)
    else:
        connector_volumes.append(0.0)
total_connector_volume = sum(connector_volumes)

# Compute total panel volume
total_panel_volume = total_board_volume + total_glue_volume + total_connector_volume

# Create the data tree for 'a'
a = DataTree[object]()

# Add lamellas to branch {0}
path_lamellas = GH_Path(0)
for i, brep in enumerate(clt_boards):
    a.Add(brep, path_lamellas)

# Add glue layers to branch {1}
path_glue = GH_Path(1)
for i, brep in enumerate(glue_layers):
    a.Add(brep, path_glue)

# Add connectors to branch {2}
path_connectors = GH_Path(2)
for i, brep in enumerate(connectors):
    a.Add(brep, path_connectors)

# Prepare the info string for 'b'
info_lines = []

info_lines.append("Panel Dimensions:")
info_lines.append("Length: {:.2f}m".format(panel_length))
info_lines.append("Width: {:.2f}m".format(panel_width))
info_lines.append("Height: {:.2f}m".format(total_thickness))
info_lines.append("Panel Volume: {:.2f}m3".format(total_panel_volume))
info_lines.append("Lamellas:")
info_lines.append("Number: {}".format(len(clt_boards)))
info_lines.append("Total Volume: {:.2f}m3".format(total_board_volume))
info_lines.append("Glue Layers:")
info_lines.append("Number: {}".format(len(glue_layers)))
info_lines.append("Total Volume: {:.2f}m3".format(total_glue_volume))
info_lines.append("Connectors:")
info_lines.append("Number: {}".format(len(connectors)))
info_lines.append("Total Volume: {:.2f}m3".format(total_connector_volume))
info_lines.append("Diameter: {:.2f}m".format(connector_diameter))
info_lines.append("Height: {:.2f}m".format(total_thickness))

b = "\n".join(info_lines)
# ---------- end python_3_script ----------
py3 = Python3Script()  # -> out, a
# ---------- py3: Python ----------
import math

# Inputs from the previous script (replace these with actual values from your script)
panel_length = 6.0  # in meters
panel_width = 1.2   # in meters (standardized as per constraints)
total_thickness = 0.2  # in meters (e.g., 200 mm)
num_layers = 5  # Odd number of layers
layer_thicknesses = [0.04, 0.04, 0.04, 0.04, 0.04]  # in meters, total should sum up to total_thickness
density = 420  # kg/m³ for C24
moisture_content = 0.13  # 13% moisture content
service_class = 1  # Indoor controlled environment
load_duration = 'medium_term'  # As per Eurocode definitions
material_grade = 'C24'  # As per EN 338

# Material Properties for C24 (from EN 338)
f_m_k = 24  # Bending strength in N/mm²
f_v_k = 3.5  # Shear strength in N/mm²
E_0_mean = 11000  # Mean modulus of elasticity parallel to grain in N/mm²
E_0_05 = 7400  # 5th percentile modulus of elasticity in N/mm²
rho_k = 350  # Characteristic density in kg/m³

# Adjustment factors
k_mod = 0.8  # Modification factor for service class 1 and medium-term load duration
gamma_M = 1.3  # Partial factor for material property uncertainties (ULS)
gamma_M_sls = 1.0  # Partial factor for SLS

# Load definitions
gk = density * total_thickness  # Dead load (self-weight) in kg/m²
gk = gk * 9.81 / 1000  # Convert to kN/m² (1 kg*m/s² = 9.81 N)
qk = 1.5  # Live load for residential floors in kN/m² (as per EN 1991-1-1)

# Load combinations (EN 1990)
# Ultimate Limit State (ULS)
gamma_G = 1.35  # Partial safety factor for permanent loads
gamma_Q = 1.5   # Partial safety factor for variable loads
design_load_ULS = gamma_G * gk + gamma_Q * qk  # in kN/m²

# Serviceability Limit State (SLS)
design_load_SLS = gk + qk  # in kN/m²

# Structural Analysis
span = panel_length  # Assuming simply supported along the length
width = panel_width
thickness = total_thickness
E = E_0_mean * 1000  # Convert E from N/mm² to N/m²

# Moment of inertia (I) and section modulus (W)
I = (width * thickness**3) / 12  # in m^4
W = I / (thickness / 2)  # in m³

# Maximum bending moment at mid-span (simply supported beam)
M_Ed = (design_load_ULS * span**2) / 8  # in kN*m

# Convert M_Ed to N*m for consistency with material strength units
M_Ed_Nm = M_Ed * 1000  # Convert kN*m to N*m

# Design bending strength (f_m_d)
f_m_d = (f_m_k * k_mod) / gamma_M  # in N/mm²

# Convert f_m_d to N/m²
f_m_d_N_per_m2 = f_m_d * 1e6  # N/mm² to N/m²

# Bending capacity (M_Rd)
M_Rd = f_m_d_N_per_m2 * W  # in N*m

# Shear force at supports
V_Ed = (design_load_ULS * span) / 2  # in kN

# Convert V_Ed to N for consistency
V_Ed_N = V_Ed * 1000  # kN to N

# Shear area (A_v)
A_v = width * thickness  # in m²

# Design shear strength (f_v_d)
f_v_d = (f_v_k * k_mod) / gamma_M  # in N/mm²

# Convert f_v_d to N/m²
f_v_d_N_per_m2 = f_v_d * 1e6  # N/mm² to N/m²

# Shear capacity (V_Rd)
V_Rd = f_v_d_N_per_m2 * A_v  # in N

# Deflection under SLS loads
delta_max = (5 * design_load_SLS * span**4) / (384 * E * I)  # in meters

# Deflection limit (e.g., span/300)
delta_limit = span / 300  # in meters

# Prepare the output text
info_lines = []

info_lines.append("STRUCTURAL ANALYSIS REPORT")
info_lines.append("=========================")
info_lines.append("")
info_lines.append("1. Material Properties:")
info_lines.append(f"   - Strength Class: {material_grade}")
info_lines.append(f"   - Density (ρ): {density} kg/m³")
info_lines.append(f"   - Modulus of Elasticity (E): {E_0_mean} N/mm²")
info_lines.append(f"   - Bending Strength (f_m,k): {f_m_k} N/mm²")
info_lines.append(f"   - Shear Strength (f_v,k): {f_v_k} N/mm²")
info_lines.append(f"   - Moisture Content: {moisture_content*100:.0f}%")
info_lines.append("")
info_lines.append("2. Panel Geometry:")
info_lines.append(f"   - Length (span): {span} m")
info_lines.append(f"   - Width: {width} m")
info_lines.append(f"   - Thickness: {thickness*1000:.0f} mm")
info_lines.append(f"   - Number of Layers: {num_layers}")
info_lines.append("")
info_lines.append("3. Loads:")
info_lines.append(f"   - Dead Load (gk): {gk:.2f} kN/m²")
info_lines.append(f"   - Live Load (qk): {qk:.2f} kN/m²")
info_lines.append(f"   - Design Load ULS: {design_load_ULS:.2f} kN/m²")
info_lines.append(f"   - Design Load SLS: {design_load_SLS:.2f} kN/m²")
info_lines.append("")
info_lines.append("4. Structural Analysis:")
info_lines.append(f"   - Maximum Bending Moment (M_Ed): {M_Ed:.2f} kN·m")
info_lines.append(f"   - Bending Capacity (M_Rd): {M_Rd/1e6:.2f} kN·m")
if M_Ed_Nm <= M_Rd:
    info_lines.append("   - Bending Capacity Check: PASS")
else:
    info_lines.append("   - Bending Capacity Check: FAIL")
info_lines.append("")
info_lines.append(f"   - Maximum Shear Force (V_Ed): {V_Ed:.2f} kN")
info_lines.append(f"   - Shear Capacity (V_Rd): {V_Rd/1000:.2f} kN")
if V_Ed_N <= V_Rd:
    info_lines.append("   - Shear Capacity Check: PASS")
else:
    info_lines.append("   - Shear Capacity Check: FAIL")
info_lines.append("")
info_lines.append(f"   - Deflection under SLS Loads (δ_max): {delta_max*1000:.2f} mm")
info_lines.append(f"   - Deflection Limit (δ_limit): {delta_limit*1000:.2f} mm")
if delta_max <= delta_limit:
    info_lines.append("   - Deflection Check: PASS")
else:
    info_lines.append("   - Deflection Check: FAIL")
info_lines.append("")
info_lines.append("5. Modification Factors:")
info_lines.append(f"   - k_mod (Service Class {service_class}, {load_duration}): {k_mod}")
info_lines.append(f"   - Partial Factor for Material (γ_M): {gamma_M}")
info_lines.append("")
info_lines.append("Conclusion:")
if (M_Ed_Nm <= M_Rd) and (V_Ed_N <= V_Rd) and (delta_max <= delta_limit):
    info_lines.append("   - The CLT panel satisfies all structural requirements.")
else:
    info_lines.append("   - The CLT panel does NOT satisfy all structural requirements. Review the design.")

# Output the results as a single text string
structural_report = "\n".join(info_lines)

# Assign the output
a = structural_report

# If running in Grasshopper, you can output 'a' to a panel
# Otherwise, print the structural report
print(structural_report)
# ---------- end py3 ----------
area = Area(Geometry=crv)  # -> Area, Centroid
X = UnitX(Factor=Slider(1.03, range=1..5))
move = Move(Geometry=area.Centroid, Motion=X)  # -> Geometry, Transform
panel_2 = Panel(python_3_script.b)
panel_3 = Panel(py3.a)
tag = TextTag3D(Location=move.Geometry, Text=panel_2, Size=Slider(0.092, range=0..0.5), Colour=RGB(0, 0, 0), Justification=7)
bang = ExplodeTree(Data=python_3_script.a)  # -> Branch0, Branch1, Branch2

entwine = Entwine(Branch00=bang.Branch0, Branch01=bang.Branch2, Branch02=bang.Branch1, FlattenInputs=True)
entwine_2 = Entwine(
    Branch00=ColourSwatch(SwatchColor=RGB(143, 133, 117)),
    Branch01=ColourSwatch(SwatchColor=RGB(112, 112, 112)),
    Branch02=ColourSwatch(SwatchColor=RGB(255, 255, 255)),
    FlattenInputs=True)
deconstruct_brep = DeconstructBrep(Brep=entwine)  # -> Faces, Edges, Vertices
custom_preview = CustomPreview(Geometry=entwine, Material=entwine_2)
custom_preview_lineweights = CustomPreviewLineweights(Geometry=deconstruct_brep.Edges, Shader=ColourSwatch(SwatchColor=RGB(0, 0, 0)), Absolute=False)
